# Dynamo graph Building Mass Generator V1 FINAL.dyn (Dynamo 3.0.3.7597)
# author: Mateo Flores - Renato Berrezueta
# Building Mass Generator V1

select_model_elements = DSModelElementsSelection()  # 4 picked in the model; graph input

# group: OffSet Generation
curves = Element.Curves(element=select_model_elements)
remember = Remember(curves)
flatten = List.Flatten(list=remember)
byJoinedCurves = PolyCurve.ByJoinedCurves(curves=flatten)
byPatch = Surface.ByPatch(closedCurve=byJoinedCurves)
code_block = CodeBlock { 0.5; }
pointAtParameter = Curve.PointAtParameter(curve=byJoinedCurves, param=code_block)
normalAtParameter = Curve.NormalAtParameter(curve=byJoinedCurves, param=code_block)
code_block_2 = CodeBlock { 1; }
translate = Geometry.Translate(geometry=pointAtParameter, direction=normalAtParameter, distance=code_block_2)
doesIntersect = Geometry.DoesIntersect(geometry=byPatch, other=translate)
reverse = Curve.Reverse(curve=byJoinedCurves)
if_ = RefactoredIf(test=doesIntersect, true=byJoinedCurves, false=reverse)
explode = Geometry.Explode(geometry=if_)
code_block_3 = CodeBlock { 0.5; }
normalAtParameter_2 = Curve.NormalAtParameter(curve=explode, param=code_block_3)
extension = DoubleInput(9000)
code_block_4 = CodeBlock { 0.1; }
code_block_5 = CodeBlock { true; }
ZAxis = Vector.ZAxis()
code_block_6 = CodeBlock { 25; }
code_block_7 = CodeBlock { 255; 0; }
byARGB = Color.ByARGB(alpha=code_block_7.out0, red=code_block_7.out0, green=code_block_7.out1, blue=code_block_7.out1)

file_path = Filename("Z:\dynamos\Building Mass Generator V1 FINAL.Dependencies\files\NORMATIVA SIN EL CENTRO - RESTRICCIONES.csv")  # graph input
importCSV = Data.ImportCSV(filePath=file_path)
flatten_2 = List.Flatten(list=remember)
byJoinedCurves_2 = PolyCurve.ByJoinedCurves(curves=flatten_2)
byPatch_2 = Surface.ByPatch(closedCurve=byJoinedCurves_2)
area = Surface.Area(surface=byPatch_2)
zonaConstruccion = CustomSelection("E-5", items={E-1: "E-1", E-2: "E-2", E-3: "E-3", E-4: "E-4", E-5: "E-5", E-6: "E-6", E-7: "E-7", E-8: "E-8", E-9: "E-9", E-10: "E-10", E-11: "E-11", E-12: "E-12", E-13: "E-13", E-14: "E-14", E-15: "E-15", E-16: "E-16", E-17: "E-17", E-18: "E-18", E-19: "E-19", E-20: "E-20", E-21: "E-21", E-22: "E-22", E-23: "E-23", E-24: "E-24", E-25: "E-25", E-26: "E-26", E-27: "E-27", E-28: "E-28", E-29: "E-29", E-30: "E-30", E-31: "E-31", E-32: "E-32", E-33: "E-33", E-34: "E-34", EJIDO-2: "EJIDO-2", EJIDO-3: "EJIDO-3", EJIDO-4: "EJIDO-4", O-1: "O-1", O-2: "O-2", O-3: "O-3", O-4: "O-4", O-5: "O-5", O-6: "O-6", O-7: "O-7", O-8: "O-8", O-9: "O-9", O-10: "O-10", O-11: "O-11", O-12: "O-12", O-13: "O-13", O-14: "O-14", O-15: "O-15", O-16: "O-16", O-17: "O-17", O-18: "O-18", O-19: "O-19", 0-20: "O-20", O-21: "O-21", O-22: "O-22", O-23: "O-23"})  # graph input
cantidadPisos = IntegerSlider(5, range=1..20 step 1)  # graph input
alturaPisos = DoubleSlider(2, range=0..3 step 0.01)  # graph input
python_script = Python(IN[0]=importCSV, IN[1]=area, IN[2]=remember, IN[3]=zonaConstruccion, IN[4]=cantidadPisos, IN[5]=alturaPisos)  # CPython3
# ---------- python_script.python (82 lines) ----------
# Load the Python Standard and DesignScript Libraries
import sys
import clr
import pandas as pd
clr.AddReference('ProtoGeometry')
from Autodesk.DesignScript.Geometry import *

# The inputs to this node will be stored as a list in the IN variables.
dataEnteringNode = IN
#codigo propio
def lista_a_dataframe(lista):
    # Extrae el nombre de las columnas
    columnas = [sublista[0] for sublista in lista]
    # Extrae los valores de las columnas
    valores = [sublista[1:] for sublista in lista]

    # Transpone la lista de valores para que cada fila sea una lista de valores
    valores_transpuestos = list(map(list, zip(*valores)))

    # Crea el DataFrame
    df = pd.DataFrame(valores_transpuestos, columns=columnas)
    return df
# Devolver las columnas después de filtrar

def incluye_rango(rango, cantidad):
    if isinstance(rango, str) and '-' in rango:
        inicio, fin = map(int, rango.split('-'))
        return inicio <= cantidad <= fin
    else:
        return int(rango) == cantidad

def calcular_salida(filas_sin_f_pisos, filas_con_f_pisos):
    if len(filas_con_f_pisos)>0:
        return filas_con_f_pisos[0][6:9]
    elif len(filas_sin_f_pisos)>0:
        return filas_sin_f_pisos[-1][6:9]
    else:
        return None
df = lista_a_dataframe(IN[0])
areaTerreno = IN[1]/1000000
tamanioFrente = IN[2][0][0].Direction.Length/1000
codigo = str(IN[3])
cantidadPisos = IN[4]
alturaPisos = IN[5]
# Filtrar el DataFrame por el código dado
df_filtrado = df[df['CODIGO'] == codigo]

# Filtrar por el frente mínimo
df_filtrado = df_filtrado[df_filtrado['FRENTE MINIMO (m)'] <= tamanioFrente]

# Filtrar por el área mínima del lote
df_filtrado = df_filtrado[df_filtrado['LOTE MINIMO (m2)'] <= areaTerreno]

columnas_finales = df_filtrado.dropna(axis=1)

if columnas_finales.empty:
    resultado = 0
elif "m" not in columnas_finales.head(1)['ALTURA EN PISOS'].to_list()[0]:
    # Filtrar el DataFrame por la cantidad de pisos
    df_filtrado_pisos = columnas_finales[columnas_finales['ALTURA EN PISOS'].apply(lambda x: incluye_rango(x, cantidadPisos))]

    if len(df_filtrado_pisos) > 0:
        columnas_finales_lista = [x*1000 for x in df_filtrado_pisos.values.tolist()[0][6:9]]
        resultado = [columnas_finales_lista[0],columnas_finales_lista[1],columnas_finales_lista[2],columnas_finales_lista[1]]
    elif len(columnas_finales) > 0:
        columnas_finales_aux = [x*1000 for x in columnas_finales.values.tolist()[-1][6:9]]
        
        cadena = str(columnas_finales.values.tolist()[-1][1])
        numeros = cadena.split("-")
        if len(numeros) > 1:
            resultado = [columnas_finales_aux[0],columnas_finales_aux[1],columnas_finales_aux[2],columnas_finales_aux[1],int(numeros[1])]
        else:
            resultado = [columnas_finales_aux[0],columnas_finales_aux[1],columnas_finales_aux[2],columnas_finales_aux[1],int(cadena)]
    else:
        resultado = 0
else:
    df_to_list = columnas_finales.values.tolist()
    alturaSinM = df_to_list[0][1].split("m")[0]
    cantidaPisosAuxCreado =int( int(alturaSinM)/alturaPisos)
    resultado = [df_to_list[0][6]*1000,df_to_list[0][7]*1000,df_to_list[0][8]*1000,df_to_list[0][7]*1000, cantidaPisosAuxCreado]
# Assign your output to the OUT variable.
OUT = resultado
# ----------------------------------------
parser = Python(IN[0]=python_script)  # CPython3
# ---------- parser.python (12 lines) ----------
# Load the Python Standard and DesignScript Libraries
import sys
import clr
clr.AddReference('ProtoGeometry')
from Autodesk.DesignScript.Geometry import *

# The inputs to this node will be stored as a list in the IN variables.
dataEnteringNode = IN

# Place your code below this line
# Assign your output to the OUT variable.
OUT = IN[0][:4][::-1]
# ----------------------------------------
offsetsList = List.Flatten(list=parser)

# group (continued): OffSet Generation
translate_2 = Geometry.Translate(geometry=explode, direction=normalAtParameter_2, distance=offsetsList)
extendStart = Curve.ExtendStart(curve=translate_2, distance=extension)
extendEnd = Curve.ExtendEnd(curve=extendStart, distance=extension)
python_script_2 = Python(IN[0]=extendEnd)  # IronPython2
# ---------- python_script_2.python (22 lines) ----------
# Load the Python Standard and DesignScript Libraries
import sys
import clr
clr.AddReference('ProtoGeometry')
from Autodesk.DesignScript.Geometry import *

# The inputs to this node will be stored as a list in the IN variables.
dataEnteringNode = IN

# Place your code below this line
puntos_interseccion = []
# Iterar sobre pares únicos de líneas
for i in range(len(IN[0])):
    for j in range(i + 1, len(IN[0])):
        l1 = IN[0][i]
        l2 = IN[0][j]
        punto_interseccion = l1.Intersect(l2)
        if punto_interseccion:
            puntos_interseccion.append(punto_interseccion[0])

# Assign your output to the OUT variable.
OUT = puntos_interseccion
# ----------------------------------------
doesIntersect_2 = Geometry.DoesIntersect(geometry=extendEnd@L1, other=python_script_2@L2, lacing=Longest)
filterByBoolMask = List.FilterByBoolMask(list=python_script_2@L2, mask=doesIntersect_2@L2, lacing=Longest)
splitByPoints = Curve.SplitByPoints(curve=extendEnd, points=filterByBoolMask.in)
pointAtParameter_2 = Curve.PointAtParameter(curve=splitByPoints, param=code_block_4)
doesIntersect_3 = Geometry.DoesIntersect(geometry=translate_2, other=pointAtParameter_2)
indexOf = List.IndexOf(list=doesIntersect_3@L2, element=code_block_5)
getItemAtIndex = List.GetItemAtIndex(list=splitByPoints@L2, index=indexOf@L1)
byJoinedCurves_3 = PolyCurve.ByJoinedCurves(curves=getItemAtIndex)
translate_3 = Geometry.Translate(geometry=byJoinedCurves_3, direction=ZAxis, distance=code_block_6)
byGeometryColor = Modifiers.GeometryColor.ByGeometryColor(geometry=translate_3, color=byARGB)

byPatch_3 = Surface.ByPatch(closedCurve=byJoinedCurves_3)
python_script_3 = Python(IN[0]=python_script)  # CPython3
# ---------- python_script_3.python (16 lines) ----------
# Load the Python Standard and DesignScript Libraries
import sys
import clr
clr.AddReference('ProtoGeometry')
from Autodesk.DesignScript.Geometry import *

# The inputs to this node will be stored as a list in the IN variables.
dataEnteringNode = IN

# Place your code below this line
listAux = IN[0]
if len(listAux) == 4:
    OUT = True
else:
    OUT = False
# Assign your output to the OUT variable.
# ----------------------------------------
code_block_8 = CodeBlock(listi=python_script) { uV= listi[-1]; }
if_personalizado = Python(IN[0]=python_script_3, IN[1]=cantidadPisos, IN[2]=code_block_8)  # CPython3
# ---------- if_personalizado.python (19 lines) ----------
# Load the Python Standard and DesignScript Libraries
import sys
import clr
clr.AddReference('ProtoGeometry')
from Autodesk.DesignScript.Geometry import *

# The inputs to this node will be stored as a list in the IN variables.
dataEnteringNode = IN

# Place your code below this line
validador = IN[0]
trueV = IN[1]
falseV= IN[2]
if validador:
    resultado = trueV
else:
    resultado = falseV
# Assign your output to the OUT variable.
OUT = resultado
# ----------------------------------------
alturaPisoEscalada = CodeBlock(ap=alturaPisos) { af=ap*1000; }

# group: Geometry [Dynamo]: Generate different floor plates based on the primary floor plate and place them at the correct hegiht
python_script_generate_optimised = Python(IN[0]=byPatch_3, IN[1]=if_personalizado, IN[2]=alturaPisoEscalada, IN[3]=byJoinedCurves_3)  # "Python Script || Generate Optimised Towers"; CPython3
# ---------- python_script_generate_optimised.python (178 lines) ----------
# Copyright 2019 designtech.io. All rights reserved.
"""
Site Layout Generator
"""
__copyright__ = 'designtech.io 2019'
__version__ = '1.0.0'

import clr  
clr.AddReference('ProtoGeometry')  
from Autodesk.DesignScript.Geometry import * 
clr.AddReference('DSCoreNodes') 
import DSCore 
from DSCore import List  
import sys 
import random 
import time 
import math
import itertools
from itertools import islice,chain

#INICIA CODIGO AQUI

# custom list splittling definition
def splitByLengths( seq, num ): 
        newList = []
        if sum(num) >= len(seq):
                min = 0
                for n in num:
                        newN = min + n
                        newList.append(seq[min:newN])
                        min += n
        else:
                num.append(len(seq)-sum(num))
                min = 0
                for n in num:
                        newN = min + n
                        newList.append(seq[min:newN])
                        min += n
        return newList

# Custom surface splitting definition
def splitSrf( surface, cutCrv, offsetDist ):  #Inputs of 'surface' (Singular), cutCurve that will slice the
    #surfaces and an offset distance
    rebuildCrv = Line.ByStartPointEndPoint( cutCrv.StartPoint, cutCrv.EndPoint )  #Rebuilding the curve as the
    #origin curve sometimes fails (No idea why)
    focusPoint = surface.PointAtParameter( 0.5, 0.5 )  #Creating a centroidal point to offset towards with our
    #splitting line
    offsetCrv = sorted( [ rebuildCrv.Offset( offsetDist ), rebuildCrv.Offset( -offsetDist ) ], 
    key = lambda x : Geometry.DistanceTo( x, focusPoint ) )[0]  #Creating an offset curve for both the positive
    #and negative directions, based off our rebuilt curve, then sorting that list based on the Distance To the
    #focus point (surface point) and from the curve geometry and taking the first value (Closest to our chosen
    #point)
    crvLen = offsetCrv.Length  #Calling the Length value of our chosen offset curve (Internal to surface)
    extendCrv = offsetCrv.ExtendStart( crvLen * 20 ).ExtendEnd( crvLen * 20  )  #Extending the start and end of 
    #our chosen curve by 3 x the length so that no matter the site constraints, we'll push out beyond it. 
    # NOTE: This may not be a viable approach but didn't fail in all prototype options
    extrudeCrv = extendCrv.Extrude( Vector.ByCoordinates( 0, 0, 1), 500).Translate( 0, 0, -250 )  #We then extrude
    #our extended curve in the Z-direction up 500 units, then translate that back down by half it's value (-250) as
    #simply cutting the surface with a 'child' object of that surface (i.e our offset periemter curve) seems to 
    #fail often. So we have to generate a new, non-relational object
    splitSrf2 = sorted( Geometry.Split( surface, extrudeCrv ), key = lambda x : x.Area )[-1]  #Splitting our surface
    #using Geometry.Split, and then sorting that list by the Area of the surfaces.
    # NOTE: This may not be a viable approach and would be better served using another approach
    [ i.Dispose() for i in [ rebuildCrv, focusPoint, offsetCrv, extendCrv, extrudeCrv ] ]  #Disposing of the 
    #geometry will clear up RAM but is ___SUPER DANGEROUS___ when not used corretly as you can dispose of things not
    #internal to the Python node but to the Dynamo graph itself. 
    return splitSrf2  #Return the chosen split surface

# Creating a bespoke rounding definition
def roundToPrecision( crv, num, precision ):  #Creating a defintion that uses a 'curve', 'number' and 'precison' value
    return math.floor( ( crv.Length / num ) / precision ) * precision  #Returning a precision value on a custom divided
    #line. i.e we want to divide our curve by 3 and then precision it to 100
    #crv.Length = 23078.987, num = 3, precision = 100
    # (23078.987 / 3) => 7692.995 / 100 => 76.929 * 100 => math.floor(7692.995 ) => 7692

# Creating a Remap-Range Definition
def remap( x, nMin, nMax ):  #Just find a C# version or build one to remap the range :) 
    #range check
    if 0 == 1:
        print("Warning: Zero input range")
        return None

    if nMin == nMax:
        print("Warning: Zero output range")
        return None

    #check reversed input range
    reverseInput = False
    oldMin = min( 0, 1 )
    oldMax = max( 0, 1 )
    if not oldMin == 0:
        reverseInput = True

    #check reversed output range
    reverseOutput = False   
    newMin = min( nMin, nMax )
    newMax = max( nMin, nMax )
    if not newMin == nMin :
        reverseOutput = True

    portion = ( x - oldMin ) * ( newMax - newMin ) / ( oldMax - oldMin )
    if reverseInput:
        portion = ( oldMax - x ) * ( newMax - newMin ) / ( oldMax - oldMin )

    result = portion + newMin
    if reverseOutput:
        result = newMax - portion

    return result

# Splitting up our floors
def splitNums( num, floorRange ):  #Creating a custom definition to split up our floor numbers
    startList = [ random.randint( 0, max( floorRange )) ]  #Creating a list comprehension of
    #a random integer between zero and the maximum number of our 'floorRange' variabble
    for n in range( num - 1 ):  #Creating a For Loop across a range from zero to our number minus 1
        #i.e n = [0, 1, 2] as an xrange object (Generator)
        _int = random.randint(0, ( max( floorRange ) - sum( startList )) )  #Creating an integer
        #randomly between zero and our maximum 'floorRange' 
        startList.append(_int)  #Append this random integer to our start list
    return startList 
    
def _flatten(l, result = None):  #Creating a custom flatten function, with a default None (null) result
    if result is None:  #If the result is None (null) then... 
        result = []  #return an empty list
    for i in l:  #Otherwise, for index inside of our list-to-flatten
        if isinstance(i, list):  #If the index item is an instance of the 'list' object
            _flatten(i, result)  #Then recursively call our custom function on that list, and populate the 
            #'result' variable with it 
        else:  #Otherwise
            result.append(i)  #Simply append the index to the result
    return result  #And return the result

# Input Ports
surface = IN[0]
numOfFloors = IN[1]
floorHeight = IN[2]
siteBoundary = IN[3]

precision = 100
srfCount = round( remap( random.random(), 2, 5 ) ) 
towerFloorRange = range( 0, numOfFloors )  
floorSplitNums = splitNums( srfCount, towerFloorRange )  

contador = 0
while 0 in floorSplitNums and contador != 10000:
    newList = splitNums( srfCount, towerFloorRange )  
    floorSplitNums = newList 
    contador=contador+1

floorOffsets = [ ( i * floorHeight ) for i in range( 1, max(towerFloorRange) + 1 ) ]  
splitUpperFloors = splitByLengths( floorOffsets, floorSplitNums ) 
splitUpperFloors[0].insert(0,0)
floorZLength = len( splitUpperFloors ) 
buildingHeight = max( floorOffsets ) + floorHeight  

srfList = [ surface ]  
modeCounter = 0  
while modeCounter < srfCount: 
        crvs = srfList[ modeCounter ].PerimeterCurves()  
        mode = List.Shuffle( crvs )[0]  
        if modeCounter == 0:  
                offsetDist = roundToPrecision(mode, 3, precision)  
        if modeCounter == 1:
            offsetDist = roundToPrecision(mode, 4, precision)  
        if modeCounter == 2:
            offsetDist = roundToPrecision(mode, 5, precision)  
        else:
            offsetDist = roundToPrecision(mode, 8, precision)  
            
        srfSplit = splitSrf( srfList[modeCounter], mode, offsetDist ) 
        srfList.append( srfSplit ) 
        
        [ i.Dispose() for i in crvs ]
        modeCounter += 1 
        
srfs = srfList 
sAreas = [ ( s.Area / 1000000 ) for s in srfs ]
OUT = srfs, splitUpperFloors, numOfFloors
# ----------------------------------------
code_block_9 = CodeBlock(x=python_script_generate_optimised) { x[2]; x[0]; x[1]; }
# note: INPUTS
# IN[0] = Random Floor Plate [Surface]
# IN[1] = Current Time [DateTime]
# IN[2] = Maximum Building Height [Double]
# IN[3] = Offset Site Boundary [Crvs]
# OUPUT
# OUT[0] = Floor Plates [Surface]
# OUT[1] = Floor Heights [Double]
# OUT[2] = Number of Floors [Int]
translate_4 = Geometry.Translate(geometry=code_block_9.out1, zTranslation=code_block_9.out2)
perimeterCurves = Surface.PerimeterCurves(surface=translate_4)

# group: Geometry [Dynamo]: Generate entire floors based on floorplates and combine them into a single solid
byJoinedCurves_4 = PolyCurve.ByJoinedCurves(curves=perimeterCurves)
code_block_10 = CodeBlock { 250; }
extrudeAsSolid = Curve.ExtrudeAsSolid(curve=byJoinedCurves_4, distance=code_block_10)
lastItem = List.LastItem(list=byJoinedCurves_4@L2)
ZAxis_2 = Vector.ZAxis()
translate_5 = Geometry.Translate(geometry=lastItem, direction=ZAxis_2, distance=alturaPisoEscalada)
count = List.Count(list=byJoinedCurves_4@L2)
insert = List.Insert(list=byJoinedCurves_4@L2, element=translate_5@L1, index=count@L1)
byLoft = Solid.ByLoft(crossSections=insert)
byUnion = Solid.ByUnion(solids=byLoft)

gate = Gate(false, extrudeAsSolid)
code_block_11 = CodeBlock { "Default"; }
byName = Material.ByName(name=code_block_11)

# group: Geometry [Dynamo/Revit]: Converts Dynamo geometry into a direct shape to be visualized inside Revit
categories = Categories("OST_Floors")
code_block_12 = CodeBlock { "Selected Building"; }
# note: NOTE:
# Unfreeze this node to generate a direct shape of the selected building in the Revit enviroment.
byGeometry = DirectShape.ByGeometry(geometry=gate, category=categories, material=byName, name=code_block_12)

# group: Visualization: Colourizes Dynamo geometry in the Background preview window
code_block_13 = CodeBlock { white = DSCore.Color.ByARGB(255,255,255,255); glass = DSCore.Color.ByARGB(150,60,145,190); }
byGeometryColor_2 = Modifiers.GeometryColor.ByGeometryColor(geometry=byUnion, color=code_block_13.glass)
byGeometryColor_3 = Modifiers.GeometryColor.ByGeometryColor(geometry=translate_4, color=code_block_13.white)

watch_3d = Watch3D(byGeometryColor_3)

# group: Matematica: Calcular area total, area construccion and area de asensores
area_terreno = Surface.Area(surface=byPatch)
area_primer_piso = Surface.Area(surface=byPatch_3)
calcular_cos_pb = CodeBlock(site=area_terreno, bldg=area_primer_piso) { pr = (site-bldg); prc = Math.Round((bldg/site)*100); }
todos_pisos_surfaces = List.Flatten(list=translate_4)
area_2 = Surface.Area(surface=todos_pisos_surfaces)
sum = Math.Sum(values=area_2)
code_block_14 = CodeBlock(x=sum) { Math.Round(x/1000000); }
area_total_construible_att = Python(IN[0]=area_terreno, IN[1]=todos_pisos_surfaces)  # IronPython2
# ---------- area_total_construible_att.python (17 lines) ----------
# Load the Python Standard and DesignScript Libraries
import sys
import clr
clr.AddReference('ProtoGeometry')
from Autodesk.DesignScript.Geometry import *

# The inputs to this node will be stored as a list in the IN variables.
dataEnteringNode = IN

# Place your code below this line

areaTerreno = IN[0]
todosPisos = IN[1]

areaTotal = areaTerreno * len(todosPisos) / 1000000
# Assign your output to the OUT variable.
OUT = areaTotal
# ----------------------------------------
code_block_15 = CodeBlock(y=area_total_construible_att) { x = Math.Round(y,2); }

# group: Outputs
# note: Salidas del modelo, se utilizaran para generar la optimizacion
COS_primer_piso = Watch(calcular_cos_pb.prc)  # graph output
area_total_construida = Watch(code_block_14)  # graph output
area_total_terreno = Watch(code_block_15)  # graph output
cantidad_pisos_finales = Watch(if_personalizado)

# group (continued): Matematica: Calcular area total, area construccion and area de asensores
lift_provisional_area = Python(IN[0]=code_block_9.out0, IN[1]=area_total_construida)  # IronPython2
# ---------- lift_provisional_area.python (11 lines) ----------
import clr
clr.AddReference('ProtoGeometry')
from Autodesk.DesignScript.Geometry import *
import math

nFloors = IN[0]
buildingTotalArea = IN[1]

liftProvision = (buildingTotalArea*(-0.18))/(nFloors-47.5)

OUT = abs(liftProvision)
# ----------------------------------------
code_block_16 = CodeBlock(y=lift_provisional_area) { x = Math.Round(y,2); }

# group (continued): Outputs
area_provisional_para_asensor = Watch(code_block_16)  # graph output

code_block_17 = CodeBlock(atc=area_total_construida, att=area_total_construible_att) { CUS = Math.Round(atc/att * 100,2); }

# group (continued): Outputs
CUS_Edificio_Total = Watch(code_block_17)  # graph output

alturaEdificio = CodeBlock(cp=if_personalizado, ap=alturaPisoEscalada) { ae = cp * ap; }
pisos_finales = Watch(if_personalizado)  # graph output
N1 = DoubleSlider(1, range=0..100 step 0.1)
N2 = DoubleSlider(1, range=0..100 step 0.1)
N3 = DoubleSlider(1, range=0..100 step 0.1)
N6 = DoubleSlider(1, range=0..100 step 0.1)
N7 = DoubleSlider(1, range=0..100 step 0.1)
N5 = DoubleSlider(1, range=0..100 step 0.1)
N4 = DoubleSlider(1, range=0..100 step 0.1)
