# Dynamo graph spaceanalysis-acoustics-04-three-points-sound-system.dyn (Dynamo 2.17.0.3472)
# packages: SpaceAnalysis 0.5.0

# note: Variables / Inputs
# Variables that can be altered per project and must be set accordingly before running the script.
# note: Working / Functions
# Core working of the script.
# note: Display / Visualization
# Logic used simply for visualization purposes, and doesn't contain core logic.

# group: Acoustics - Three Sound Points in Sound System
# note: DYNAMO PROJECT
# spaceanalysis-acoustics-04-three-points-sound-system.dyn
# note: ASSOCIATED FILE(S)
# N/A
# note: AUTHOR(S) / CREATION DATE
# Autodesk Research / 2021
# note: DESCRIPTION
# Acoustics example with sound system consisting of three synchonized sound sources
# note: DYNAMO VERSION
# 2.17.0
# note: ADDITIONAL COMMENTS
# N/A
# note: REQUIRED DYNAMO PACKAGES
# SpaceAnalysis

# group: Sound Points & Local Intensities
number_slider = DoubleSlider(4.149, range=-8.091..100 step 0.1)
number_slider_2 = DoubleSlider(14.454, range=-15.703..100 step 0.1)
byCoordinates = Point.ByCoordinates(x=number_slider, y=number_slider_2)
number_slider_3 = DoubleSlider(12.033, range=-8.677..100 step 0.1)
number_slider_4 = DoubleSlider(18.676, range=-2.512..100 step 0.1)
byCoordinates_2 = Point.ByCoordinates(x=number_slider_3, y=number_slider_4)
number_slider_5 = DoubleSlider(15.884, range=-8.091..100 step 0.1)
number_slider_6 = DoubleSlider(13.87, range=-15.703..100 step 0.1)
byCoordinates_3 = Point.ByCoordinates(x=number_slider_5, y=number_slider_6)
number_slider_7 = DoubleSlider(0.5, range=0..1 step 0.01)
number_slider_8 = DoubleSlider(1, range=0..1 step 0.01)
number_slider_9 = DoubleSlider(0.75, range=0..1 step 0.01)

list_create = List.Create(item0=byCoordinates, item1=byCoordinates_2, item2=byCoordinates_3)

# group: Display Sound Point Markers
code_block = CodeBlock { 0.25; }
byCenterPointRadius = Circle.ByCenterPointRadius(centerPoint=list_create, radius=code_block)
color_palette = ColorPalette({R: 255, G: 255, B: 0, A: 255})
byGeometryColor = Modifiers.GeometryColor.ByGeometryColor(geometry=byCenterPointRadius, color=color_palette)

# group: Outer Boundary
code_block_2 = CodeBlock { [0, 20, 20, 0]; }
code_block_3 = CodeBlock { [0, 0, 40, 40]; }
byCoordinates_4 = Point.ByCoordinates(x=code_block_2, y=code_block_3)
code_block_4 = CodeBlock { [20, 20, 0, 0]; }
code_block_5 = CodeBlock { [0, 40, 40, 0]; }
byCoordinates_5 = Point.ByCoordinates(x=code_block_4, y=code_block_5)
byStartPointEndPoint = Line.ByStartPointEndPoint(startPoint=byCoordinates_4, endPoint=byCoordinates_5)

# group: Internal Boundary
number_slider_10 = DoubleSlider(14.934, range=-5.692..100 step 0.1)
number_slider_11 = DoubleSlider(22.294, range=-16.8..100 step 0.1)
byCoordinates_6 = Point.ByCoordinates(x=number_slider_10, y=number_slider_11)
number_slider_12 = DoubleSlider(5.418, range=-6.882..100 step 0.1)
number_slider_13 = DoubleSlider(27.651, range=-5.141..100 step 0.1)
byCoordinates_7 = Point.ByCoordinates(x=number_slider_12, y=number_slider_13)
byStartPointEndPoint_2 = Line.ByStartPointEndPoint(startPoint=byCoordinates_6, endPoint=byCoordinates_7)

# group: Internal Boundary
number_slider_14 = DoubleSlider(11.96, range=-5.692..100 step 0.1)
number_slider_15 = DoubleSlider(16.113, range=-16.8..100 step 0.1)
byCoordinates_8 = Point.ByCoordinates(x=number_slider_14, y=number_slider_15)
number_slider_16 = DoubleSlider(4.033, range=-6.882..100 step 0.1)
number_slider_17 = DoubleSlider(11.005, range=-5.141..100 step 0.1)
byCoordinates_9 = Point.ByCoordinates(x=number_slider_16, y=number_slider_17)
byStartPointEndPoint_3 = Line.ByStartPointEndPoint(startPoint=byCoordinates_8, endPoint=byCoordinates_9)

join = List.Join(list0=byStartPointEndPoint_2, list1=byStartPointEndPoint_3)
code_block_6 = CodeBlock(lines=join) { lines; }

# group: Create SpaceLattice
byGeometry = BoundingBox.ByGeometry(geom=byStartPointEndPoint)
code_block_7 = CodeBlock { 0.5; }
byBoundingBoxAndLines = SpaceAnalysis.Core.SpaceLattice.ByBoundingBoxAndLines(boundingBox=byGeometry, barriers=code_block_6, resolution=code_block_7)

list_create_2 = List.Create(item0=number_slider_7, item1=number_slider_8, item2=number_slider_9)

# group: Sound System
bySoundPointsAndIntensities = SpaceAnalysis.Acoustics.SoundSystem.BySoundPointsAndIntensities(soundPoints=list_create, localIntensities=list_create_2)

# group: Sound Intensity
number_slider_18 = DoubleSlider(1, range=0..1 step 0.01)

# group: Sound Absorption
number_slider_19 = DoubleSlider(0.05, range=0..1 step 0.01)

points = SpaceAnalysis.Core.SpaceLattice.Points(spaceLattice=byBoundingBoxAndLines)

# group: Create AudibilityGrid
code_block_8 = CodeBlock { 15; }
bySpaceLatticeAndSoundSystem = SpaceAnalysis.Acoustics.SoundField.BySpaceLatticeAndSoundSystem(spaceLattice=byBoundingBoxAndLines, soundSystem=bySoundPointsAndIntensities, radius=code_block_8, intensity=number_slider_18, absorption=number_slider_19)
bySoundField = SpaceAnalysis.Acoustics.AudibilityGrid.BySoundField(soundField=bySpaceLatticeAndSoundSystem)
valueAtPoint = SpaceAnalysis.Acoustics.AudibilityGrid.ValueAtPoint(audibilityGrid=bySoundField, point=points)

surface = SpaceAnalysis.Core.SpaceLattice.Surface(spaceLattice=byBoundingBoxAndLines)

# group: Display Values of the AudibilityGrid
code_block_9 = CodeBlock(inputValues=valueAtPoint, surface=surface) { inputValues; surface; }
code_block_10 = CodeBlock()
# ---------- code_block_10.designscript (10 lines) ----------
a = 100;
DSCore.Color.ByARGB(a,225, 242, 247);
DSCore.Color.ByARGB(a,206, 232, 229);
DSCore.Color.ByARGB(a,177, 210, 211);
DSCore.Color.ByARGB(a,140, 192, 198);
DSCore.Color.ByARGB(a,131, 186, 211);
DSCore.Color.ByARGB(a,152, 146, 237);
DSCore.Color.ByARGB(a,186, 132, 245);
DSCore.Color.ByARGB(a,217, 100, 241);
DSCore.Color.ByARGB(a,255, 119, 226);
# ----------------------------------------
list_create_3 = List.Create(item0=code_block_10.out1, item1=code_block_10.out2, item2=code_block_10.out3, item3=code_block_10.out4, item4=code_block_10.out5, item5=code_block_10.out6, item6=code_block_10.out7, item7=code_block_10.out8, item8=code_block_10.out9)
code_block_11 = CodeBlock { 0..1..#9; }
code_block_12 = CodeBlock { 0; 1; }
map = Math.Map(rangeMin=code_block_12.out0, rangeMax=code_block_12.out1, inputValue=code_block_9.inputValues)
color_range = ColorRange(colors=list_create_3, indices=code_block_11, value=map)
bySurfaceColors = Modifiers.GeometryColor.BySurfaceColors(surface=code_block_9.surface, colors=color_range)

# group: Get Wavelength of simulated sound
wavelength = SpaceAnalysis.Acoustics.SoundField.Wavelength(soundField=bySpaceLatticeAndSoundSystem)
watch = Watch(wavelength)
