# Dynamo graph spaceanalysis-acoustics-05-two-points-interference-validation.dyn (Dynamo 2.17.0.3472)
# packages: SpaceAnalysis 0.5.0

# note: Variables / Inputs
# Variables that can be altered per project and must be set accordingly before running the script.
# note: Working / Functions
# Core working of the script.
# note: Display / Visualization
# Logic used simply for visualization purposes, and doesn't contain core logic.

# group: Acoustics - Two Sound Points & Interference Validation
# note: DYNAMO PROJECT
# spaceanalysis-acoustics-05-two-points-interference-validation.dyn
# note: ASSOCIATED FILE(S)
# N/A
# note: AUTHOR(S) / CREATION DATE
# Autodesk Research / 2021
# note: DESCRIPTION
# Acoustics example recreating physical experiment:
# https://xmdemo.wordpress.com/2014/03/20/016/
# note: DYNAMO VERSION
# 2.17.0
# note: ADDITIONAL COMMENTS
# N/A
# note: REQUIRED DYNAMO PACKAGES
# SpaceAnalysis

# group: Sound Points
code_block = CodeBlock { 0; }
byCoordinates = Point.ByCoordinates(x=code_block, y=code_block)
code_block_2 = CodeBlock { 100; }
byCoordinates_2 = Point.ByCoordinates(x=code_block_2, y=code_block)

# group: Sound System
list_create = List.Create(item0=byCoordinates, item1=byCoordinates_2)
bySoundPoints = SpaceAnalysis.Acoustics.SoundSystem.BySoundPoints(soundPoints=list_create)

# group: Display Sound Point Markers
code_block_3 = CodeBlock { 1; }
byCenterPointRadius = Circle.ByCenterPointRadius(centerPoint=list_create, radius=code_block_3)
color_palette = ColorPalette({R: 255, G: 255, B: 0, A: 255})
byGeometryColor = Modifiers.GeometryColor.ByGeometryColor(geometry=byCenterPointRadius, color=color_palette)

# group: Outer Boundary
code_block_4 = CodeBlock { [-50, -50, 150, -50]; }
code_block_5 = CodeBlock { [-50, -50, -50, 50]; }
byCoordinates_3 = Point.ByCoordinates(x=code_block_4, y=code_block_5)
code_block_6 = CodeBlock { [150, -50, 150, 150]; }
code_block_7 = CodeBlock { [-50, 50, 50, 50]; }
byCoordinates_4 = Point.ByCoordinates(x=code_block_6, y=code_block_7)
byStartPointEndPoint = Line.ByStartPointEndPoint(startPoint=byCoordinates_3, endPoint=byCoordinates_4)

# group: Create SpaceLattice
byGeometry = BoundingBox.ByGeometry(geom=byStartPointEndPoint)
empty = List.Empty()
code_block_8 = CodeBlock { 3.789; }
byBoundingBoxAndLines = SpaceAnalysis.Core.SpaceLattice.ByBoundingBoxAndLines(boundingBox=byGeometry, barriers=empty, resolution=code_block_8)

points = SpaceAnalysis.Core.SpaceLattice.Points(spaceLattice=byBoundingBoxAndLines)

# group: Create AudibilityGrid
bySpaceLatticeAndSoundSystem = SpaceAnalysis.Acoustics.SoundField.BySpaceLatticeAndSoundSystem(spaceLattice=byBoundingBoxAndLines, soundSystem=bySoundPoints)
bySoundField = SpaceAnalysis.Acoustics.AudibilityGrid.BySoundField(soundField=bySpaceLatticeAndSoundSystem)
valueAtPoint = SpaceAnalysis.Acoustics.AudibilityGrid.ValueAtPoint(audibilityGrid=bySoundField, point=points)

surface = SpaceAnalysis.Core.SpaceLattice.Surface(spaceLattice=byBoundingBoxAndLines)

# group: Display Values of the AudibilityGrid
code_block_9 = CodeBlock(inputValues=valueAtPoint, surface=surface) { inputValues; surface; }
code_block_10 = CodeBlock()
# ---------- code_block_10.designscript (10 lines) ----------
a = 100;
DSCore.Color.ByARGB(a,225, 242, 247);
DSCore.Color.ByARGB(a,206, 232, 229);
DSCore.Color.ByARGB(a,177, 210, 211);
DSCore.Color.ByARGB(a,140, 192, 198);
DSCore.Color.ByARGB(a,131, 186, 211);
DSCore.Color.ByARGB(a,152, 146, 237);
DSCore.Color.ByARGB(a,186, 132, 245);
DSCore.Color.ByARGB(a,217, 100, 241);
DSCore.Color.ByARGB(a,255, 119, 226);
# ----------------------------------------
list_create_2 = List.Create(item0=code_block_10.out1, item1=code_block_10.out2, item2=code_block_10.out3, item3=code_block_10.out4, item4=code_block_10.out5, item5=code_block_10.out6, item6=code_block_10.out7, item7=code_block_10.out8, item8=code_block_10.out9)
code_block_11 = CodeBlock { 0..1..#9; }
code_block_12 = CodeBlock { 0; 1; }
map = Math.Map(rangeMin=code_block_12.out0, rangeMax=code_block_12.out1, inputValue=code_block_9.inputValues)
color_range = ColorRange(colors=list_create_2, indices=code_block_11, value=map)
bySurfaceColors = Modifiers.GeometryColor.BySurfaceColors(surface=code_block_9.surface, colors=color_range)

# group: Display Ruler
code_block_13 = CodeBlock { 1; }
range = Range(start=code_block, end=code_block_2, step=code_block_13)
code_block_14 = CodeBlock { 0; }
byCoordinates_5 = Point.ByCoordinates(x=range, y=code_block_14)

# group: Get Wavelength of simulated sound
wavelength = SpaceAnalysis.Acoustics.SoundField.Wavelength(soundField=bySpaceLatticeAndSoundSystem)
watch = Watch(wavelength)

# group: Calculate Frequency of simulated sound
code_block_15 = CodeBlock(wavelength=watch) { frequency = 343/(wavelength/100); }
watch_2 = Watch(code_block_15)
