# Dynamo graph spaceanalysis-acoustics-06-six-points-voronoi-pattern.dyn (Dynamo 2.17.0.3472)
# packages: SpaceAnalysis 0.5.0

# note: Variables / Inputs
# Variables that can be altered per project and must be set accordingly before running the script.
# note: Working / Functions
# Core working of the script.
# note: Display / Visualization
# Logic used simply for visualization purposes, and doesn't contain core logic.

# group: Acoustics - Six Sound Points & Voronoi Pattern
# note: DYNAMO PROJECT
# spaceanalysis-acoustics-06-six-points-voronoi-pattern.dyn
# note: ASSOCIATED FILE(S)
# N/A
# note: AUTHOR(S) / CREATION DATE
# Autodesk Research / 2021
# note: DESCRIPTION
# Acoustics example with six synchonized sources creating a Voronoi interference pattern
# note: DYNAMO VERSION
# 2.17.0
# note: ADDITIONAL COMMENTS
# N/A
# note: REQUIRED DYNAMO PACKAGES
# SpaceAnalysis

# group: Outer Boundary
code_block = CodeBlock { [-50, -50, 150, -50]; }
code_block_2 = CodeBlock { [-50, -50, -50, 50]; }
byCoordinates = Point.ByCoordinates(x=code_block, y=code_block_2)
code_block_3 = CodeBlock { [150, -50, 150, 150]; }
code_block_4 = CodeBlock { [-50, 50, 50, 50]; }
byCoordinates_2 = Point.ByCoordinates(x=code_block_3, y=code_block_4)
byStartPointEndPoint = Line.ByStartPointEndPoint(startPoint=byCoordinates, endPoint=byCoordinates_2)

# group: Create SpaceLattice
byGeometry = BoundingBox.ByGeometry(geom=byStartPointEndPoint)
empty = List.Empty()
code_block_5 = CodeBlock { 1; }
byBoundingBoxAndLines = SpaceAnalysis.Core.SpaceLattice.ByBoundingBoxAndLines(boundingBox=byGeometry, barriers=empty, resolution=code_block_5)

# group: Sound Points
number_slider = DoubleSlider(-14.284, range=-21.21..100 step 0.1)
number_slider_2 = DoubleSlider(17.081, range=0..100 step 0.1)
byCoordinates_3 = Point.ByCoordinates(x=number_slider, y=number_slider_2)
number_slider_3 = DoubleSlider(-23.498, range=-26.383..100 step 0.1)
number_slider_4 = DoubleSlider(-17.472, range=-35.532..100 step 0.1)
byCoordinates_4 = Point.ByCoordinates(x=number_slider_3, y=number_slider_4)
number_slider_5 = DoubleSlider(47.734, range=0..100 step 0.1)
number_slider_6 = DoubleSlider(30.608, range=0..100 step 0.1)
byCoordinates_5 = Point.ByCoordinates(x=number_slider_5, y=number_slider_6)
number_slider_7 = DoubleSlider(40.815, range=0..104.606 step 0.1)
number_slider_8 = DoubleSlider(-33.273, range=-35.921..100 step 0.1)
byCoordinates_6 = Point.ByCoordinates(x=number_slider_7, y=number_slider_8)
number_slider_9 = DoubleSlider(126.03, range=0..126.03 step 0.1)
number_slider_10 = DoubleSlider(32.002, range=0..100 step 0.1)
byCoordinates_7 = Point.ByCoordinates(x=number_slider_9, y=number_slider_10)
number_slider_11 = DoubleSlider(79.147, range=0..124.126 step 0.1)
number_slider_12 = DoubleSlider(-27.084, range=-46.08..100 step 0.1)
byCoordinates_8 = Point.ByCoordinates(x=number_slider_11, y=number_slider_12)

# group: Sound System
list_create = List.Create(item0=byCoordinates_3, item1=byCoordinates_4, item2=byCoordinates_5, item3=byCoordinates_6, item4=byCoordinates_7, item5=byCoordinates_8)
bySoundPoints = SpaceAnalysis.Acoustics.SoundSystem.BySoundPoints(soundPoints=list_create)

points = SpaceAnalysis.Core.SpaceLattice.Points(spaceLattice=byBoundingBoxAndLines)

# group: Create AudibilityGrid
bySpaceLatticeAndSoundSystem = SpaceAnalysis.Acoustics.SoundField.BySpaceLatticeAndSoundSystem(spaceLattice=byBoundingBoxAndLines, soundSystem=bySoundPoints)
bySoundField = SpaceAnalysis.Acoustics.AudibilityGrid.BySoundField(soundField=bySpaceLatticeAndSoundSystem)
valueAtPoint = SpaceAnalysis.Acoustics.AudibilityGrid.ValueAtPoint(audibilityGrid=bySoundField, point=points)

surface = SpaceAnalysis.Core.SpaceLattice.Surface(spaceLattice=byBoundingBoxAndLines)

# group: Display Values of the AudibilityGrid
code_block_6 = CodeBlock(inputValues=valueAtPoint, surface=surface) { inputValues; surface; }
code_block_7 = CodeBlock()
# ---------- code_block_7.designscript (10 lines) ----------
a = 100;
DSCore.Color.ByARGB(a,225, 242, 247);
DSCore.Color.ByARGB(a,206, 232, 229);
DSCore.Color.ByARGB(a,177, 210, 211);
DSCore.Color.ByARGB(a,140, 192, 198);
DSCore.Color.ByARGB(a,131, 186, 211);
DSCore.Color.ByARGB(a,152, 146, 237);
DSCore.Color.ByARGB(a,186, 132, 245);
DSCore.Color.ByARGB(a,217, 100, 241);
DSCore.Color.ByARGB(a,255, 119, 226);
# ----------------------------------------
list_create_2 = List.Create(item0=code_block_7.out1, item1=code_block_7.out2, item2=code_block_7.out3, item3=code_block_7.out4, item4=code_block_7.out5, item5=code_block_7.out6, item6=code_block_7.out7, item7=code_block_7.out8, item8=code_block_7.out9)
code_block_8 = CodeBlock { 0..1..#9; }
code_block_9 = CodeBlock { 0; 1; }
map = Math.Map(rangeMin=code_block_9.out0, rangeMax=code_block_9.out1, inputValue=code_block_6.inputValues)
color_range = ColorRange(colors=list_create_2, indices=code_block_8, value=map)
bySurfaceColors = Modifiers.GeometryColor.BySurfaceColors(surface=code_block_6.surface, colors=color_range)

# group: Get Wavelength of simulated sound
wavelength = SpaceAnalysis.Acoustics.SoundField.Wavelength(soundField=bySpaceLatticeAndSoundSystem)
watch = Watch(wavelength)

# group: Calculate Frequency of simulated sound
code_block_10 = CodeBlock(wavelength=watch) { frequency = 343/(wavelength/100); }
watch_2 = Watch(code_block_10)

# group: Display Sound Point Markers
code_block_11 = CodeBlock { 1; }
byCenterPointRadius = Circle.ByCenterPointRadius(centerPoint=list_create, radius=code_block_11)
color_palette = ColorPalette({R: 255, G: 255, B: 0, A: 255})
byGeometryColor = Modifiers.GeometryColor.ByGeometryColor(geometry=byCenterPointRadius, color=color_palette)
