# Dynamo graph spaceanalysis-pathfinding-01-one-path.dyn (Dynamo 2.17.0.3472)
# packages: SpaceAnalysis 0.5.0

# note: Variables / Inputs
# Variables that can be altered per project and must be set accordingly before running the script.
# note: Working / Functions
# Core working of the script.
# note: Display / Visualization
# Logic used simply for visualization purposes, and doesn't contain core logic.

# group: Pathfinding - One Path
# note: DYNAMO PROJECT
# spaceanalysis-pathfinding-01-one-path.dyn
# note: ASSOCIATED FILE(S)
# N/A
# note: AUTHOR(S) / CREATION DATE
# Autodesk Research / 2021
# note: DESCRIPTION
# Simple shortest path example
# note: DYNAMO VERSION
# 2.17.0
# note: ADDITIONAL COMMENTS
# N/A
# note: REQUIRED DYNAMO PACKAGES
# SpaceAnalysis

# group: Internal Boundary
number_slider = DoubleSlider(2.949, range=-5.692..100 step 0.1)
number_slider_2 = DoubleSlider(-5.811, range=-16.8..100 step 0.1)
byCoordinates = Point.ByCoordinates(x=number_slider, y=number_slider_2)
number_slider_3 = DoubleSlider(-4.019, range=-6.882..100 step 0.1)
number_slider_4 = DoubleSlider(-2.98, range=-5.141..100 step 0.1)
byCoordinates_2 = Point.ByCoordinates(x=number_slider_3, y=number_slider_4)
byStartPointEndPoint = Line.ByStartPointEndPoint(startPoint=byCoordinates, endPoint=byCoordinates_2)

# group: Outer Boundary
code_block = CodeBlock { [-10, -10, 10, 10]; }
code_block_2 = CodeBlock { [-20, 20, 20, -20]; }
byCoordinates_3 = Point.ByCoordinates(x=code_block, y=code_block_2)
code_block_3 = CodeBlock { [-10, 10, 10, -10]; }
code_block_4 = CodeBlock { [20, 20, -20, -20]; }
byCoordinates_4 = Point.ByCoordinates(x=code_block_3, y=code_block_4)
byStartPointEndPoint_2 = Line.ByStartPointEndPoint(startPoint=byCoordinates_3, endPoint=byCoordinates_4)

join = List.Join(list0=byStartPointEndPoint, list1=byStartPointEndPoint_2)
code_block_5 = CodeBlock(lines=join) { lines; }

# group: Compute Lattice
byGeometry = BoundingBox.ByGeometry(geom=code_block_5)
code_block_6 = CodeBlock { 1; }
byBoundingBoxAndLines = SpaceAnalysis.Core.SpaceLattice.ByBoundingBoxAndLines(boundingBox=byGeometry, barriers=code_block_5, resolution=code_block_6)

# group: Start & End Point
number_slider_5 = DoubleSlider(-0.715, range=-8.091..100 step 0.1)
number_slider_6 = DoubleSlider(-13.626, range=-15.703..100 step 0.1)
byCoordinates_5 = Point.ByCoordinates(x=number_slider_5, y=number_slider_6)
number_slider_7 = DoubleSlider(0.291, range=-8.677..100 step 0.1)
number_slider_8 = DoubleSlider(0.511, range=-2.512..100 step 0.1)
byCoordinates_6 = Point.ByCoordinates(x=number_slider_7, y=number_slider_8)

bySpaceLattice = SpaceAnalysis.Pathfinding.Route.BySpaceLattice(spaceLattice=byBoundingBoxAndLines, startPoint=byCoordinates_5, endPoint=byCoordinates_6)

# group: Route Smoothness
number_slider_9 = DoubleSlider(10, range=0..50 step 1)

# group: Display Path as PolyCurve
curve = SpaceAnalysis.Pathfinding.Route.Curve(route=bySpaceLattice, tidyIterations=number_slider_9)
ZAxis = Vector.ZAxis()
code_block_7 = CodeBlock { 0.01; }
translate = Geometry.Translate(geometry=curve, direction=ZAxis, distance=code_block_7)
color_palette = ColorPalette({R: 0, G: 0, B: 255, A: 255})
byGeometryColor = Modifiers.GeometryColor.ByGeometryColor(geometry=translate, color=color_palette)

# group: Display Lattice as Edges
edges = SpaceAnalysis.Core.SpaceLattice.Edges(spaceLattice=byBoundingBoxAndLines)
color_palette_2 = ColorPalette({R: 50, G: 205, B: 50, A: 98})
byGeometryColor_2 = Modifiers.GeometryColor.ByGeometryColor(geometry=edges, color=color_palette_2)

# group: Display Start and End Point Markers
code_block_8 = CodeBlock { 0.25; }
byCenterPointRadius = Circle.ByCenterPointRadius(centerPoint=byCoordinates_6, radius=code_block_8)
color_palette_3 = ColorPalette({R: 255, G: 0, B: 255, A: 255})
byGeometryColor_3 = Modifiers.GeometryColor.ByGeometryColor(geometry=byCenterPointRadius, color=color_palette_3)
code_block_9 = CodeBlock { 0.25; }
byCenterPointRadius_2 = Circle.ByCenterPointRadius(centerPoint=byCoordinates_5, radius=code_block_9)
code_block_10 = CodeBlock { 4; }
regularPolygon = Polygon.RegularPolygon(circle=byCenterPointRadius_2, numberSides=code_block_10)
color_palette_4 = ColorPalette({R: 75, G: 0, B: 130, A: 255})
byGeometryColor_4 = Modifiers.GeometryColor.ByGeometryColor(geometry=regularPolygon, color=color_palette_4)
