# Dynamo graph spaceanalysis-pathfinding-04-one-path-with-python-iteration.dyn (Dynamo 2.17.0.3472)
# packages: SpaceAnalysis 0.5.0

# note: Variables / Inputs
# Variables that can be altered per project and must be set accordingly before running the script.
# note: Working / Functions
# Core working of the script.
# note: Display / Visualization
# Logic used simply for visualization purposes, and doesn't contain core logic.

# group: Pathfinding - One Path with Python Iteration
# note: DYNAMO PROJECT
# spaceanalysis-pathfinding-04-one-path-with-python-iteration.dyn
# note: ASSOCIATED FILE(S)
# N/A
# note: AUTHOR(S) / CREATION DATE
# Autodesk Research / 2021
# note: DESCRIPTION
# Shortest path example with point iteration and filtering in python
# note: DYNAMO VERSION
# 2.17.0
# note: ADDITIONAL COMMENTS
# N/A
# note: REQUIRED DYNAMO PACKAGES
# SpaceAnalysis

# group: Internal Boundary
number_slider = DoubleSlider(5.13, range=-5.692..100 step 0.1)
number_slider_2 = DoubleSlider(-2.963, range=-16.8..100 step 0.1)
byCoordinates = Point.ByCoordinates(x=number_slider, y=number_slider_2)
number_slider_3 = DoubleSlider(-6.518, range=-6.547..100 step 0.1)
number_slider_4 = DoubleSlider(7.617, range=0..100 step 0.1)
byCoordinates_2 = Point.ByCoordinates(x=number_slider_3, y=number_slider_4)
byStartPointEndPoint = Line.ByStartPointEndPoint(startPoint=byCoordinates, endPoint=byCoordinates_2)

# group: Outer Boundary
code_block = CodeBlock { [-10, -10, 10, 10]; }
code_block_2 = CodeBlock { [-20, 20, 20, -20]; }
byCoordinates_3 = Point.ByCoordinates(x=code_block, y=code_block_2)
code_block_3 = CodeBlock { [-10, 10, 10, -10]; }
code_block_4 = CodeBlock { [20, 20, -20, -20]; }
byCoordinates_4 = Point.ByCoordinates(x=code_block_3, y=code_block_4)
byStartPointEndPoint_2 = Line.ByStartPointEndPoint(startPoint=byCoordinates_3, endPoint=byCoordinates_4)

join = List.Join(list0=byStartPointEndPoint, list1=byStartPointEndPoint_2)
code_block_5 = CodeBlock(lines=join) { lines; }

# group: Compute Lattice
byGeometry = BoundingBox.ByGeometry(geom=code_block_5)
code_block_6 = CodeBlock { 1; }
byBoundingBoxAndLines = SpaceAnalysis.Core.SpaceLattice.ByBoundingBoxAndLines(boundingBox=byGeometry, barriers=code_block_5, resolution=code_block_6)

# group: Start & End Point
number_slider_5 = DoubleSlider(-2.348, range=-6.916..100 step 0.1)
number_slider_6 = DoubleSlider(-13.684, range=-13.684..100 step 0.1)
byCoordinates_5 = Point.ByCoordinates(x=number_slider_5, y=number_slider_6)
number_slider_7 = DoubleSlider(3.382, range=-4.218..100 step 0.1)
number_slider_8 = DoubleSlider(6.803, range=0..100 step 0.1)
byCoordinates_6 = Point.ByCoordinates(x=number_slider_7, y=number_slider_8)

# group: Find Shortest Route
bySpaceLattice = SpaceAnalysis.Pathfinding.Route.BySpaceLattice(spaceLattice=byBoundingBoxAndLines, startPoint=byCoordinates_5, endPoint=byCoordinates_6)

# group: Route Smoothness
number_slider_9 = DoubleSlider(20, range=0..50 step 1)

# group: Display Path as PolyCurve
curve = SpaceAnalysis.Pathfinding.Route.Curve(route=bySpaceLattice, tidyIterations=number_slider_9)
ZAxis = Vector.ZAxis()
code_block_7 = CodeBlock { 0.01; }
translate = Geometry.Translate(geometry=curve, direction=ZAxis, distance=code_block_7)
color_palette = ColorPalette({R: 0, G: 0, B: 255, A: 255})
byGeometryColor = Modifiers.GeometryColor.ByGeometryColor(geometry=translate, color=color_palette)

# group: Display Lattice as Edges
edges = SpaceAnalysis.Core.SpaceLattice.Edges(spaceLattice=byBoundingBoxAndLines)
color_palette_2 = ColorPalette({R: 50, G: 205, B: 50, A: 98})
byGeometryColor_2 = Modifiers.GeometryColor.ByGeometryColor(geometry=edges, color=color_palette_2)

# group: Couple alternatives of iterating & filtering points in python
filter_point_with_paths_using = Python(IN[0]=byBoundingBoxAndLines)  # "Filter Point with Paths using XCoordinates & YCoordinates"; CPython3; unwired: IN[1], IN[2]
# ---------- filter_point_with_paths_using.python (19 lines) ----------
import clr
clr.AddReference('ProtoGeometry')
from Autodesk.DesignScript.Geometry import *
from SpaceAnalysis.Core import SpaceLattice

spaceLattice = IN[0]

ptsOut = []
for x_coord in spaceLattice.XCoordinates():
    for y_coord in spaceLattice.YCoordinates():
        pt = Point.ByCoordinates(x_coord, y_coord)
        hasDir = False
        for dir in SpaceLattice.NeighborDirections():
            if(spaceLattice.HasPath(pt, dir)):
                hasDir = True
            if (hasDir):
                ptsOut.append(pt)

OUT = ptsOut
# ----------------------------------------
filter_point_with_paths_using_2 = Python(IN[0]=byBoundingBoxAndLines)  # "Filter Point with Paths using Points"; CPython3; unwired: IN[1], IN[2]
# ---------- filter_point_with_paths_using_2.python (19 lines) ----------
import clr
clr.AddReference('ProtoGeometry')
from Autodesk.DesignScript.Geometry import *
from SpaceAnalysis.Core import SpaceLattice

spaceLattice = IN[0]

pts = spaceLattice.Points()
ptsOut = []
for pt_row in pts:
    for pt in pt_row:
        hasDir = False
        for dir in SpaceLattice.NeighborDirections():
            if(spaceLattice.HasPath(pt, dir)):
                hasDir = True
            if (hasDir):
                ptsOut.append(pt)

OUT = ptsOut
# ----------------------------------------

# group: Couple alternatives of getting All points.
XCoordinates = SpaceAnalysis.Core.SpaceLattice.XCoordinates(spaceLattice=byBoundingBoxAndLines)
YCoordinates = SpaceAnalysis.Core.SpaceLattice.YCoordinates(spaceLattice=byBoundingBoxAndLines)
byCoordinates_7 = Point.ByCoordinates(x=XCoordinates, y=YCoordinates, lacing=CrossProduct)
points = SpaceAnalysis.Core.SpaceLattice.Points(spaceLattice=byBoundingBoxAndLines)

# group: Display Start and End Point Markers
code_block_8 = CodeBlock { 0.25; }
byCenterPointRadius = Circle.ByCenterPointRadius(centerPoint=byCoordinates_5, radius=code_block_8)
code_block_9 = CodeBlock { 4; }
regularPolygon = Polygon.RegularPolygon(circle=byCenterPointRadius, numberSides=code_block_9)
color_palette_3 = ColorPalette({R: 75, G: 0, B: 130, A: 255})
byGeometryColor_3 = Modifiers.GeometryColor.ByGeometryColor(geometry=regularPolygon, color=color_palette_3)
code_block_10 = CodeBlock { 0.25; }
byCenterPointRadius_2 = Circle.ByCenterPointRadius(centerPoint=byCoordinates_6, radius=code_block_10)
color_palette_4 = ColorPalette({R: 255, G: 0, B: 255, A: 255})
byGeometryColor_4 = Modifiers.GeometryColor.ByGeometryColor(geometry=byCenterPointRadius_2, color=color_palette_4)
