# Dynamo graph spaceanalysis-visibility-02-one-point-global-visibility.dyn (Dynamo 2.17.0.3472)
# packages: SpaceAnalysis 0.5.0

# note: Variables / Inputs
# Variables that can be altered per project and must be set accordingly before running the script.
# note: Working / Functions
# Core working of the script.
# note: Display / Visualization
# Logic used simply for visualization purposes, and doesn't contain core logic.

# group: Visibility - One View Point & Global Visibility
# note: DYNAMO PROJECT
# spaceanalysis-visibility-02-one-point-global-visibility.dyn
# note: ASSOCIATED FILE(S)
# N/A
# note: AUTHOR(S) / CREATION DATE
# Autodesk Research / 2021
# note: DESCRIPTION
# Simple visibility example displaying global visibility values
# note: DYNAMO VERSION
# 2.17.0
# note: ADDITIONAL COMMENTS
# N/A
# note: REQUIRED DYNAMO PACKAGES
# SpaceAnalysis

# group: Outer Boundary
code_block = CodeBlock { [0, 20, 20, 0]; }
code_block_2 = CodeBlock { [0, 0, 40, 40]; }
byCoordinates = Point.ByCoordinates(x=code_block, y=code_block_2)
code_block_3 = CodeBlock { [20, 20, 0, 0]; }
code_block_4 = CodeBlock { [0, 40, 40, 0]; }
byCoordinates_2 = Point.ByCoordinates(x=code_block_3, y=code_block_4)
byStartPointEndPoint = Line.ByStartPointEndPoint(startPoint=byCoordinates, endPoint=byCoordinates_2)

# group: Internal Boundary
number_slider = DoubleSlider(14.934, range=-5.692..100 step 0.1)
number_slider_2 = DoubleSlider(22.294, range=-16.8..100 step 0.1)
byCoordinates_3 = Point.ByCoordinates(x=number_slider, y=number_slider_2)
number_slider_3 = DoubleSlider(5.418, range=-6.882..100 step 0.1)
number_slider_4 = DoubleSlider(27.651, range=-5.141..100 step 0.1)
byCoordinates_4 = Point.ByCoordinates(x=number_slider_3, y=number_slider_4)
byStartPointEndPoint_2 = Line.ByStartPointEndPoint(startPoint=byCoordinates_3, endPoint=byCoordinates_4)

# group: Internal Boundary
number_slider_5 = DoubleSlider(11.96, range=-5.692..100 step 0.1)
number_slider_6 = DoubleSlider(16.113, range=-16.8..100 step 0.1)
byCoordinates_5 = Point.ByCoordinates(x=number_slider_5, y=number_slider_6)
number_slider_7 = DoubleSlider(4.033, range=-6.882..100 step 0.1)
number_slider_8 = DoubleSlider(11.005, range=-5.141..100 step 0.1)
byCoordinates_6 = Point.ByCoordinates(x=number_slider_7, y=number_slider_8)
byStartPointEndPoint_3 = Line.ByStartPointEndPoint(startPoint=byCoordinates_5, endPoint=byCoordinates_6)

join = List.Join(list0=byStartPointEndPoint_2, list1=byStartPointEndPoint_3)
code_block_5 = CodeBlock(lines=join) { lines; }

# group: Create SpaceLattice
byGeometry = BoundingBox.ByGeometry(geom=byStartPointEndPoint)
code_block_6 = CodeBlock { 1; }
byBoundingBoxAndLines = SpaceAnalysis.Core.SpaceLattice.ByBoundingBoxAndLines(boundingBox=byGeometry, barriers=code_block_5, resolution=code_block_6)

# group: Display Lattice as Edges
edges = SpaceAnalysis.Core.SpaceLattice.Edges(spaceLattice=byBoundingBoxAndLines)
color_palette = ColorPalette({R: 50, G: 205, B: 50, A: 98})
byGeometryColor = Modifiers.GeometryColor.ByGeometryColor(geometry=edges, color=color_palette)

# group: View Point & Sample Point
number_slider_9 = DoubleSlider(14.383, range=-8.677..100 step 0.1)
number_slider_10 = DoubleSlider(31.724, range=-2.512..100 step 0.1)
byCoordinates_7 = Point.ByCoordinates(x=number_slider_9, y=number_slider_10)
number_slider_11 = DoubleSlider(9.436, range=-8.091..100 step 0.1)
number_slider_12 = DoubleSlider(20.981, range=-15.703..100 step 0.1)
byCoordinates_8 = Point.ByCoordinates(x=number_slider_11, y=number_slider_12)

points = SpaceAnalysis.Core.SpaceLattice.Points(spaceLattice=byBoundingBoxAndLines)

# group: Create VisibilityGrid
code_block_7 = CodeBlock { 10; }
bySpaceLatticeAndViewPoint = SpaceAnalysis.Visibility.ViewField.BySpaceLatticeAndViewPoint(spaceLattice=byBoundingBoxAndLines, viewPoint=byCoordinates_8, radius=code_block_7)
byViewField = SpaceAnalysis.Visibility.VisibilityGrid.ByViewField(viewField=bySpaceLatticeAndViewPoint)
valueAtPoint = SpaceAnalysis.Visibility.VisibilityGrid.ValueAtPoint(visibilityGrid=byViewField, point=points)

# group: Test Visibility for one Point
valueAtPoint_2 = SpaceAnalysis.Visibility.VisibilityGrid.ValueAtPoint(visibilityGrid=byViewField, point=byCoordinates_7)
watch = Watch(valueAtPoint_2)

# group: Display View and Sample Point Markers
code_block_8 = CodeBlock { 0.25; }
add = code_block_8 + watch
byCenterPointRadius = Circle.ByCenterPointRadius(centerPoint=byCoordinates_7, radius=add)
color_palette_2 = ColorPalette({R: 255, G: 0, B: 255, A: 255})
byGeometryColor_2 = Modifiers.GeometryColor.ByGeometryColor(geometry=byCenterPointRadius, color=color_palette_2)
code_block_9 = CodeBlock { 0.25; }
byCenterPointRadius_2 = Circle.ByCenterPointRadius(centerPoint=byCoordinates_8, radius=code_block_9)
color_palette_3 = ColorPalette({R: 0, G: 191, B: 255, A: 255})
byGeometryColor_3 = Modifiers.GeometryColor.ByGeometryColor(geometry=byCenterPointRadius_2, color=color_palette_3)

surface = SpaceAnalysis.Core.SpaceLattice.Surface(spaceLattice=byBoundingBoxAndLines)

# group: Display Values of the VisibilityGrid
code_block_10 = CodeBlock(inputValues=valueAtPoint, surface=surface) { inputValues; surface; }
code_block_11 = CodeBlock()
# ---------- code_block_11.designscript (10 lines) ----------
a = 100;
DSCore.Color.ByARGB(a,0, 0, 4);
DSCore.Color.ByARGB(a,28, 16, 68);
DSCore.Color.ByARGB(a,79, 18, 123);
DSCore.Color.ByARGB(a,129, 37, 129);
DSCore.Color.ByARGB(a,181, 54, 122);
DSCore.Color.ByARGB(a,229, 89, 100);
DSCore.Color.ByARGB(a,251, 135, 97);
DSCore.Color.ByARGB(a,254, 194, 135);
DSCore.Color.ByARGB(a,251, 253, 191);
# ----------------------------------------
list_create = List.Create(item0=code_block_11.out1, item1=code_block_11.out2, item2=code_block_11.out3, item3=code_block_11.out4, item4=code_block_11.out5, item5=code_block_11.out6, item6=code_block_11.out7, item7=code_block_11.out8, item8=code_block_11.out9)
code_block_12 = CodeBlock { 0..1..#9; }
code_block_13 = CodeBlock { 0.25; 0.75; }
map = Math.Map(rangeMin=code_block_13.out0, rangeMax=code_block_13.out1, inputValue=code_block_10.inputValues)
color_range = ColorRange(colors=list_create, indices=code_block_12, value=map)
bySurfaceColors = Modifiers.GeometryColor.BySurfaceColors(surface=code_block_10.surface, colors=color_range)
